# Grasshopper definition Level_Annotate_and Areas.gh (Grasshopper 0.9.14)

crv_levels = Curve([<curve referenced from the Rhino model> x55])
brep = Brep(<brep referenced from the Rhino model>)

end = EndPoints(Curve=crv_levels)  # -> Start, End
vcomp = Decompose(Vector=end.Start)  # -> XComponent, YComponent, ZComponent
sort = SortList(Keys=vcomp.ZComponent, ValuesA=crv_levels)  # -> Keys, ValuesA

end_2 = EndPoints(Curve=sort.ValuesA)  # -> Start, End
xy = XYPlane(Origin=end_2.End)
sec = BrepPlane(Brep=brep, Plane=xy)  # -> flatten(Curves), Points

pt = PointXYZ(XComponent=0, YComponent=0, ZComponent=sort.Keys, System=PlaneXY(0, 0, 0))
lng = ListLength(List=pt)
dom = Domain(DomainStart="1", DomainEnd=lng)
range = Range(Domain=dom, Steps=expr("N-1", lng))
int = Integer(range)

area = Area(Geometry=sec.Curves)  # -> Area, Centroid
division = Division(A=area.Area, B="1000000")

tag = TextTag(Location=pt, Text=int)

concat = Concatenate(A=int, B=" @ ")
int_2 = Integer(division)
concat_2 = Concatenate(A=concat, B=int_2)

officelevels = Panel("""46
45
44
43
42
41
40
39
38
37
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""")
item = ListItem(List=sec.Curves, Index=expr("i-1", officelevels), Wrap=False)
item_2 = ListItem(List=area.Centroid, Index=expr("i-1", officelevels), Wrap=False)
item_3 = ListItem(List=concat_2, Index=expr("i-1", officelevels), Wrap=False)
item_4 = ListItem(List=int_2, Index=expr("i-1", officelevels), Wrap=False)
ma = MassAddition(Input=item_4)  # -> Result, PartialResults
office_total_area_target_76_000 = Panel(ma.Result)
crv = Curve(item)
tag_2 = TextTag(Location=item_2, Text=item_3)

flatten = FlattenTree(Data=int, Path="{0}")
path_mapper = PathMapper(flatten, source="{0}", target="{1}")
merge = Merge(Data1=division, Data2=path_mapper)
rev = ReverseList(List=merge)
towergrossarea_list = Panel(rev)
