# Grasshopper definition ListShift-FrontBack.gh (Grasshopper 0.9.64)

# ----
# SHIFT LIST - FRONT & BACK
pt = Point()
lng = ListLength(List=pt)  # -> expr("L-1", Length)
dom = ConstructDomain(DomainStart="0", DomainEnd=expr("b-1", lng))
dom_2 = ConstructDomain(DomainStart="1", DomainEnd=lng)
subset = SubList(List=pt, Domain=dom, Wrap=True)  # -> List, Index
subset_2 = SubList(List=pt, Domain=dom_2, Wrap=True)  # -> List, Index
