# Grasshopper definition STAGGERED_PATTERN-TWO-CURVES.gh (Grasshopper 0.9.76)

crv = Curve([<curve referenced from the Rhino model> x31])
crv_2 = Curve([<curve referenced from the Rhino model> x33])
crv_directional = Curve([<curve referenced from the Rhino model> x4])
crv_lateral = Curve([<curve referenced from the Rhino model> x147])
curvepoint = PointOnCurve(crv, parameter=0.5)

# ----
# IMPORTANT:
# MAKE SURE LINES ARE SORTED PROPERLY!!!
end = EndPoints(Curve=crv_directional)  # -> Start, End
pt = Point(end.End)
pdecon = Deconstruct(Point=pt)  # -> XComponent, YComponent, ZComponent
sort = SortList(Keys=pdecon.XComponent, ValuesA=crv_directional)  # -> Keys, ValuesA
crv_3 = Curve(sort.ValuesA)

end_2 = EndPoints(Curve=crv_lateral)  # -> Start, End
pt_2 = Point(end_2.Start)
pdecon_2 = Deconstruct(Point=pt_2)  # -> XComponent, YComponent, ZComponent
sort_2 = SortList(Keys=pdecon_2.YComponent, ValuesA=crv_lateral)  # -> Keys, ValuesA
crv_4 = Curve(sort_2.ValuesA)

curvepoint_2 = PointOnCurve(crv_2, parameter=0.5)
end_3 = EndPoints(Curve=crv_2)  # -> Start, End
X = UnitX(Factor=1)
crv_5 = Curve([<curve referenced from the Rhino model> x247])
X_2 = UnitX(Factor=1)
Z = UnitZ(Factor=1)
pt_3 = Point(end_3.Start)
end_4 = EndPoints(Curve=crv_5)  # -> Start, End
line = LineSDL(Start=curvepoint_2, Direction=X, Length="50000")
pdecon_3 = Deconstruct(Point=end_4.End)  # -> XComponent, YComponent, ZComponent
line_2 = LineSDL(Start=curvepoint, Direction=X_2, Length="40000")
sort_3 = SortList(Keys=pdecon_3.YComponent, ValuesA=crv_5)  # -> Keys, ValuesA
panel = Panel("""true
false""")
crv_6 = Curve(sort_3.ValuesA)

# ----
# SHIFT LIST - FRONT & BACK
lng = ListLength(List=crv_3)  # -> expr("x-1", Length)
dom = ConstructDomain(DomainStart="0", DomainEnd=expr("x-1", lng))
dom_2 = ConstructDomain(DomainStart="1", DomainEnd=lng)
subset = SubList(List=crv_3, Domain=dom, Wrap=True)  # -> List, Index
subset_2 = SubList(List=crv_3, Domain=dom_2, Wrap=True)  # -> List, Index

number_slider = Slider(0.25, range=0..1)
cull = CullPattern(List=sort_3.ValuesA, CullPattern=invert(panel))
cull_2 = CullPattern(List=sort_3.ValuesA, CullPattern=panel)
item = ListItem(List=crv_6, Index=Slider(697, range=0..1000), Wrap=True)
Z_2 = UnitZ(Factor=1)

graft = GraftTree(Tree=crv_4, IncludeEmptyLists=True, IncludeNullItems=True)
ccx = CurveCurve(CurveA=subset.List, CurveB=graft)  # -> Points, ParamsA, ParamsB
ccx_2 = CurveCurve(CurveA=subset_2.List, CurveB=graft)  # -> Points, ParamsA, ParamsB
ln = Line(StartPoint=ccx.Points, EndPoint=ccx_2.Points)
panel_2 = Panel("""true
false""")
path_mapper = PathMapper(ln, source="{a;b;c}(d)", target="{b}(c)")

bool = Boolean(panel_2)

cull_3 = CullPattern(List=path_mapper, CullPattern=invert(bool))
cull_4 = CullPattern(List=path_mapper, CullPattern=bool)
flip = FlipMatrix(Data=cull_3)
flip_2 = FlipMatrix(Data=cull_4)

not = GateNot(A=panel_2)
bool_2 = Boolean(not)

cull_5 = CullPattern(List=flip_2, CullPattern=invert(bool_2))
cull_6 = CullPattern(List=flip, CullPattern=bool_2)

cull_7 = CullPattern(List=cull_5, CullPattern=bool)
flip_3 = FlipMatrix(Data=cull_5)
cull_8 = CullPattern(List=flip_3, CullPattern=invert(bool))
curvepoint_3 = PointOnCurve(cull_8, parameter=0.5)
line_3 = LineSDL(Start=curvepoint_3, Direction=Z_2, Length="5000")
end_5 = EndPoints(Curve=line_3)  # -> Start, End
sph = Sphere(Base=end_5.Start, Radius="15")
