# Grasshopper definition SynchronizeSort-Collection.gh (Grasshopper 0.9.64)

srf = Surface([<surface referenced from the Rhino model> x21])
crv = Curve([<curve referenced from the Rhino model> x21])
area = Area(Geometry=srf)  # -> Area, Centroid
pdecon = Deconstruct(Point=area.Centroid)  # -> XComponent, YComponent, ZComponent
xy = XYPlane(Origin=Point(0, 0, 0))
pt = ConstructPoint(XCoordinate=pdecon.XComponent, YCoordinate=pdecon.YComponent, ZCoordinate=0)
plx = LinePlane(Line=crv, Plane=xy)  # -> Point, ParamL, ParamP
cp = ClosestPoint(Point=plx.Point, Cloud=pt)  # -> ClosestPoint, CPIndex, Distance
sort = SortList(Keys=cp.CPIndex, ValuesA=crv)  # -> Keys, ValuesA
srf_2 = Surface(srf)
crv_2 = Curve(sort.ValuesA)
