# Grasshopper definition offsetcurve_on_surface-interpolated.gh (Grasshopper 0.9.76)

srf = Surface(<surface referenced from the Rhino model>)
edges = BrepEdges(Brep=srf)  # -> Naked, Interior, NonManifold
item = ListItem(List=edges.Naked, Index=Slider(1, range=0..10), Wrap=True)
divide = DivideCurve(Curve=item, Count="25", Kinks=False)  # -> Points, Tangents, Parameters
srf_cp = SurfaceClosestPoint(Point=divide.Points, Surface=srf)  # -> Point, UVPoint, Distance
iso = IsoCurve(Surface=srf, UVPoint=srf_cp.UVPoint)  # -> UIsocurve, VIsocurve
p_n_c = PickNChoose(Pattern=Toggle(False), Stream0=iso.UIsocurve, Stream1=iso.VIsocurve)
crv = Curve(p_n_c)
flatten = FlattenTree(Tree=crv, Path="{0}")
crv_2 = Curve(flatten)
end = EndPoints(Curve=crv_2)  # -> Start, End
graft = GraftTree(Tree=end.Start, IncludeEmptyLists=True, IncludeNullItems=True)
graft_2 = GraftTree(Tree=end.End, IncludeEmptyLists=True, IncludeNullItems=True)
p_n_c_2 = PickNChoose(Pattern=Toggle(True), Stream0=graft, Stream1=graft_2)  # -> flatten(Result)
sph = Sphere(Base=p_n_c_2, Radius=Slider(150, range=0..1000))
bcx = BrepCurve(Brep=sph, Curve=crv_2)  # -> Curves, Points
flatten_2 = FlattenTree(Tree=bcx.Points, Path="{0}")
intcrv = Interpolate(Vertices=flatten_2, Degree=3, Periodic=False, KnotStyle=1)  # -> Curve, Length, Domain
pull = PullCurve(Curve=intcrv.Curve, Surface=srf)
